# Grasshopper definition surface_mapping_network.gh (Grasshopper 1.0.4)

number_slider = Slider(3000, range=0..3000)
number_slider_2 = Slider(3, range=0..10)
planesrf = PlaneSurface(Plane=PlaneXY(0, 0, 0), XSize=number_slider, YSize=number_slider)
series = Series(Start=0, Step=number_slider, Count=number_slider_2)
series_2 = Series(Start=0, Step=number_slider, Count=Slider(4, range=0..10))

# ---- group: cylinder as looping surfaces
cyl = Cylinder(Base=PlaneXY(0, 0, 0), Radius=Slider(3500, range=0..4000), Length=Slider(9000, range=0..10000))
python = GhPythonScript()  # -> out, a
# ---------- python: Python ----------
__author__ = "ytakzk"
__version__ = "2019.02.23"

import Rhino.Geometry as rg

a = []

for i in range(3):
    
    a.append(rg.Interval(i/3, (i + 1)/3))
# ---------- end python ----------
dom² = ConstructDomain²(DomainU=python.a, DomainV=graft(python.a))  # -> flatten(_2DDomain)
subsrf = Isotrim(Surface=reparameterize(cyl), Domain=dom²)
python_2 = GhPythonScript(x=subsrf)  # -> out, a; inputs x: list of Surface
# ---------- python_2: Python ----------
__author__ = "ytakzk"
__version__ = "2019.02.23"

import Rhino.Geometry as rg

for s in x[3:6]:

    s.Reverse(0, True)
    domain = rg.Interval(0, 1)
    s.SetDomain(0, domain)

import random
random.shuffle(x)
a = x
# ---------- end python_2 ----------

# ----
X = UnitX(Factor=series)
Y = UnitY(Factor=series_2)  # -> graft(UnitVector)
move = Move(Geometry=planesrf, Motion=X)  # -> Geometry, Transform
move_2 = Move(Geometry=move.Geometry, Motion=Y)  # -> flatten(Geometry), Transform
srf = Surface(move_2.Geometry)

# ---- group: Jonas's surfaces
srf_2 = Surface([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])
python_3 = GhPythonScript(surfaces=srf_2)  # -> out, a; inputs surfaces: list of Surface
# ---------- python_3: Python ----------
__author__ = "ytakzk"
__version__ = "2019.02.24"

import Rhino.Geometry as rg

a = []

for i, s in enumerate(surfaces):
    
    domain = rg.Interval(0, 1)
    
    if i > 1:
        s = s.Reverse(0)
        s.SetDomain(0, domain)
    
    a.append(s)
# ---------- end python_3 ----------

# ---- group: in reality, must be done manually
python_4 = GhPythonScript(surfaces=srf, u_num=number_slider_2)  # -> out, organized_surfaces; inputs surfaces: list of Surface, u_num: Int32
# ---------- python_4: Python ----------
__author__ = "ytakzk"
__version__ = "2019.02.20"

import Rhino.Geometry as rg

organized_surfaces = []

for i, s in enumerate(surfaces):
    
    x = i % u_num
    y = int(i / u_num)
    
    domain = rg.Interval(0, 1)
    
#    if (x + y) % 2 == 1:
#        s = s.Reverse(1)
#        s.SetDomain(1, domain)
#        s = s.Reverse(0)
#        s.SetDomain(0, domain)

    if y % 2 == 1:
#        s = s.Reverse(1)
#        s.SetDomain(1, domain)
        s = s.Reverse(0)
        s.SetDomain(0, domain)
    
    if x == u_num - 1:
        s = s.Reverse(0)
        s.SetDomain(0, domain)
        
    organized_surfaces.append(s)
# ---------- end python_4 ----------

# ---- group: one surface
item = ListItem(List=srf, Index=0, Wrap=True)
srf_3 = Surface(item)

# ---- group: keystone surfaces
srf_4 = Surface([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])

# ---- group: keystone surfaces 2
srf_5 = Surface([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])

# ----
uvn = UVN(srf=srf_5)
python_5 = GhPythonScript(surfaces=srf_5)  # -> out, beams, dowels, tmp, warped_surfaces, local_networks; inputs surfaces: list of Surface
# ---------- python_5: Python ----------
__author__ = "ytakzk"
__version__ = "2019.02.23"

import sys
import Rhino.Geometry as rg

from geometry import LocalNetwork, GlobalNetwork

dowels = []
beams = []
tmp = []

global_network = GlobalNetwork(surfaces, u_div=3, v_div=5)

local_networks = global_network.local_networks

for local_network in local_networks:
    
    local_dowels = local_network.add_three_beams_connection()
    dowels.extend([d.brep_representation() for d in local_dowels])

    local_dowels = local_network.add_two_beams_connection()
    dowels.extend([d.brep_representation() for d in local_dowels])

    local_beams = [b.brep_representation(make_holes=False) for b in local_network.get_flatten_beams()]
    beams.extend(local_beams)
    

warped_surfaces = [s.surface for s in global_network.surfaces]
# ---------- end python_5 ----------
python_6 = GhPythonScript(toggle=Button())  # -> out, a
# ---------- python_6: Python ----------
__author__ = "ytakzk"
__version__ = "2019.01.21"

import geometry

if toggle:
    
    reload(geometry)
# ---------- end python_6 ----------

# ---- group: numbering for keystones
python_7 = GhPythonScript(s=python_5.warped_surfaces)  # -> out, center; inputs s: Surface
# ---------- python_7: Python ----------
__author__ = "ytakzk"
__version__ = "2019.02.25"


import Rhino.Geometry as rg

center = s.PointAt(0.5, 0.5)
# ---------- end python_7 ----------
points = PointList(Points=python_7.center, Size="600")

# ----
geo = Geometry(python_5.dowels)
geo_2 = Geometry(python_5.beams)
preview = CustomPreview(
    Geometry=geo_2,
    Material={diffuse=RGB(0, 0, 205), emission=RGB(66, 48, 66), shine=0.5, specular=RGB(255, 255, 255), transparency=0.7})

# ---- group: keystone generation
panel = Panel("""2,3,4
0,1,5""")
python_8 = GhPythonScript(surfaces=python_5.warped_surfaces, keystone_index_list=panel)  # -> out, keystone_surfaces; inputs surfaces: list of Surface
# ---------- python_8: Python ----------
__author__ = "ytakzk"
__version__ = "2019.02.24"

import System
import Rhino.Geometry as rg
import Grasshopper.Kernel.Data.GH_Path as ghpath
import Grasshopper.DataTree as datatree
from geometry import Keystone

keystone_surfaces = datatree[System.Object]()

# ceonvert string to nested numerical list

index_nested_list = []

for vals in keystone_index_list.split('\n'):

    nums = [int(v) for v in vals.split(',')]
    index_nested_list.append(nums)

print index_nested_list

for i, index_list in enumerate(index_nested_list):
    
    surfaces = [surfaces[i] for i in index_list]

    keystone = Keystone(surfaces, split_function=1)
    _, generated_surfaces = keystone.output()
    
    for s in generated_surfaces:
        path = ghpath(i)
        keystone_surfaces.Add(s, path)
# ---------- end python_8 ----------
uvn_2 = UVN(srf=python_8.keystone_surfaces)
preview_2 = CustomPreview(
    Geometry=python_8.keystone_surfaces,
    Material={diffuse=RGB(0, 191, 255), emission=RGB(66, 48, 66), shine=0.5, specular=RGB(255, 255, 255), transparency=0.6})

# ---- group: beams on keystones
python_9 = GhPythonScript(surfaces=python_8.keystone_surfaces)  # -> out, beams, dowels, local_networks; inputs surfaces: list of Surface
# ---------- python_9: Python ----------
__author__ = "ytakzk"
__version__ = "2019.02.23"

import sys
import Rhino.Geometry as rg

from geometry import LocalNetwork, GlobalNetwork

dowels = []
beams = []
tmp = []

global_network = GlobalNetwork(surfaces, u_div=5, v_div=5)

local_networks = global_network.local_networks

for local_network in local_networks:
    
    local_dowels = local_network.add_three_beams_connection()
    dowels.extend([d.brep_representation() for d in local_dowels])

    local_dowels = local_network.add_two_beams_connection()
    dowels.extend([d.brep_representation() for d in local_dowels])

    local_beams = [b.brep_representation(make_holes=False) for b in local_network.get_flatten_beams()]
    beams.extend(local_beams)
    

warped_surfaces = [s.surface for s in global_network.surfaces]
# ---------- end python_9 ----------

# ---- group: fabrication sequence check
merge = Merge(Data1=python_9.local_networks, Data2=python_5.local_networks)  # -> flatten(Result)
python_10 = GhPythonScript(local_networks=merge)  # -> out, beams; inputs local_networks: list
# ---------- python_10: Python ----------
__author__ = "ytakzk"
__version__ = "2019.02.24"

import System
import Grasshopper.Kernel.Data.GH_Path as ghpath
import Grasshopper.DataTree as datatree

beams = datatree[System.Object]()

for i, local_network in enumerate(local_networks):
    
    local_beams = [b.brep_representation(make_holes=False) for b in local_network.get_flatten_beams()]
    
    path = ghpath(i)
    
    for b in local_beams:
        beams.Add(b, path)
# ---------- end python_10 ----------
panel_2 = Panel(python_10.beams)
item_2 = ListItem(List=python_10.beams, Index=Slider(0, range=0..20), Wrap=True)
preview_3 = CustomPreview(
    Geometry=item_2,
    Material={diffuse=RGB(0, 255, 255), emission=RGB(66, 48, 66), shine=0.5, specular=RGB(255, 255, 255), transparency=0.3})

# ==== cluster UVN
srf = ClusterInput()
number_slider = Slider(5, range=0..110)
extract_uv_vec = GhPythonScript(srf=srf)  # -> out, center_pt, u_vec, v_vec, normal; inputs srf: Surface
# ---------- extract_uv_vec: Python ----------
__author__ = "Wenqian"
__version__ = "2019.01.22"

import rhinoscriptsyntax as rs
import Rhino.Geometry as rg

srf.SetDomain(0,rg.Interval(0,1))
srf.SetDomain(1,rg.Interval(0,1))

center_pt = srf.PointAt(0.5,0.5)

u_vec = srf.FrameAt(0.5,0.5)[1].XAxis
v_vec = srf.FrameAt(0.5,0.5)[1].YAxis

normal =srf.NormalAt(0.5,0.5)
# ---------- end extract_uv_vec ----------
multiplication = Multiplication(A=extract_uv_vec.v_vec, B=500)
multiplication_2 = Multiplication(A=extract_uv_vec.normal, B=500)
multiplication_3 = Multiplication(A=extract_uv_vec.u_vec, B=500)
vdisex = VectorDisplayEx(
    Point=extract_uv_vec.center_pt,
    Vector=multiplication_3,
    Colour=ColourSwatch(SwatchColor=RGB(255, 0, 0)),
    Width=number_slider)
vdisex_2 = VectorDisplayEx(
    Point=extract_uv_vec.center_pt,
    Vector=multiplication,
    Colour=ColourSwatch(SwatchColor=RGB(33, 220, 0)),
    Width=number_slider)
vdisex_3 = VectorDisplayEx(
    Point=extract_uv_vec.center_pt,
    Vector=multiplication_2,
    Colour=ColourSwatch(SwatchColor=RGB(255, 255, 255)),
    Width=number_slider)
